# Grasshopper definition hanger_4.303.gh (Grasshopper 1.0.8)
# plug-ins: Pufferfish

pt = Point("0,0,0")

pt_2 = ConstructPoint(XCoordinate=0, YCoordinate=Slider(20, range=0..100), ZCoordinate=0)
move = Move(Geometry=pt, Motion=pt_2)  # -> Geometry, Transform

number_slider = Slider(20, range=0..100)  # disabled
pt_3 = ConstructPoint(XCoordinate=0, YCoordinate=number_slider, ZCoordinate=0)  # disabled
move_2 = Move(Geometry=pt, Motion=pt_3)  # -> Geometry, Transform; disabled

expression = Expression(Expression="PI / 2")

number_slider_2 = Slider(3.5, range=0..10)
arc = Arc(Plane=move.Geometry, Radius=number_slider_2, Angle=expression)  # -> Arc, Length
end = EndPoints(Curve=arc.Arc)  # -> Start, End
pt_4 = ConstructPoint(XCoordinate=0, YCoordinate=Slider(-6, range=-20..100), ZCoordinate=0)
arc_2 = Arc(Plane=move.Geometry, Radius=number_slider_2, Angle=expression)  # -> Arc, Length

neg = Negative(Value=expression)
arc_3 = Arc(Plane=pt, Radius=Slider(0.05, range=0..1), Angle=neg)  # -> Arc, Length
pt_5 = ConstructPoint(XCoordinate=0, YCoordinate=Slider(20, range=0..20), ZCoordinate=0)
end_2 = EndPoints(Curve=arc_3.Arc)  # -> Start, End

bzspan = BezierSpan(StartPoint=end_2.Start, StartTangent=pt_5, EndPoint=end.Start, EndTangent=pt_4)  # -> Curve, Length, Domain
join = JoinCurves(Curves=[bzspan.Curve, arc_2.Arc, arc_3.Arc], Preserve=False)
mirror = Mirror(Geometry=join, Plane=PlaneYZ(0, 0, 0))  # -> Geometry, Transform
geo = Geometry(mirror.Geometry)
join_2 = JoinCurves(Curves=[geo, join], Preserve=False)

pt_6 = ConstructPoint(XCoordinate=0, YCoordinate=Slider(-1, range=-10..20), ZCoordinate=Slider(5, range=0..20))
move_3 = Move(Geometry=join_2, Motion=pt_6)  # -> Geometry, Transform
offset = OffsetCurve(Curve=move_3.Geometry, Distance=Slider(1.62, range=0..2), Corners=1)

loft = Loft(
    Curves=flatten([offset, join_2]),
    Options={Adjust=False, Closed=False, LoftEnds=0, LoftSimp=0, LoftType=0, Rebuild=10, Refit=0.01})  # -> flatten(Loft)
offset_2 = OffsetSurface(Surface=loft, Distance=Slider(0.79, range=-2..2), Retrim=True)
debrep = DeconstructBrep(Brep=loft)  # -> Faces, Edges, Vertices
debrep_2 = DeconstructBrep(Brep=offset_2)  # -> Faces, Edges, Vertices
item = ListItem(List=debrep.Edges, Index=0, Wrap=True)  # -> Item, Item1, Item2
item_2 = ListItem(List=debrep_2.Edges, Index=0, Wrap=True)  # -> Item, Item1, Item2
loft_2 = Loft(
    Curves=[item.Item2, item_2.Item2],
    Options={Adjust=False, Closed=False, LoftEnds=0, LoftSimp=0, LoftType=0, Rebuild=10, Refit=0.01})
loft_3 = Loft(
    Curves=[item.Item1, item_2.Item1],
    Options={Adjust=False, Closed=False, LoftEnds=0, LoftSimp=0, LoftType=0, Rebuild=10, Refit=0.01})
join_3 = BrepJoin(Breps=flatten([loft, offset_2, loft_3, loft_2]))  # -> Breps, Closed

number_slider_3 = Slider(3, range=0..5)
pt_7 = Point([<point referenced from the Rhino model> x4])
intcrv = Interpolate(Vertices=pt_7, Degree=number_slider_3, Periodic=False, KnotStyle=Slider(1, range=0..2))  # -> Curve, Length, Domain; disabled
nurbs = NurbsCurve(Vertices=pt_7, Degree=number_slider_3, Periodic=False)  # -> Curve, Length, Domain
pframes = PerpFrames(Curve=nurbs.Curve, Count=Slider(14, range=10..50), Align=True)  # -> Frames, Parameters
lng = ListLength(List=pframes.Frames)
series = Series(Start=Slider(2.2, range=0..10), Step=Slider(0, range=0..10), Count=lng)
polygon = Polygon(Plane=pframes.Frames, Radius=series, Segments=Slider(3, range=3..5), FilletRadius=Slider(0.7, range=0..10))  # -> flatten(Polygon), Length

crv = Curve(item_2.Item2)
flip = FlipCurve(Curve=crv)  # -> Curve, Flag
crv_2 = Curve(item_2.Item1)
shatter = Shatter(Curve=reparameterize([crv_2, flip.Curve]), Parameters=[Slider(0.6, range=0..1), Slider(0.5, range=0..1)])
item_3 = ListItem(List=shatter, Index=0, Wrap=True)  # -> flatten(Item)
loft_4 = Loft(Curves=item_3, Options={Adjust=False, Closed=False, LoftEnds=0, LoftSimp=0, LoftType=0, Rebuild=10, Refit=0.01})
flip_2 = Flip(Surface=loft_4)  # -> Surface, Result
debrep_3 = DeconstructBrep(Brep=flip_2.Surface)  # -> Faces, Edges, Vertices
shift = ShiftList(List=debrep_3.Edges, Shift=Slider(0, range=0..3), Wrap=True)
join_4 = JoinCurves(Curves=shift, Preserve=False)  # -> flatten(Curves)

loft_5 = Loft(
    Curves=flatten([join_4, polygon.Polygon]),
    Options={Adjust=False, Closed=False, LoftEnds=0, LoftSimp=0, LoftType=0, Rebuild=10, Refit=0.01})
join_5 = BrepJoin(Breps=[loft_5, loft_4])  # -> Breps, Closed
cap = CapHoles(Brep=join_5.Breps)
mirror_2 = Mirror(Geometry=cap, Plane=PlaneYZ(0, 0, 0))  # -> Geometry, Transform
merge = Merge(Data1=join_3.Breps, Data2=cap, Data3=mirror_2.Geometry)

number_slider_4 = Slider(1, range=0..100)  # disabled
number_slider_5 = Slider(1, range=0..100)  # disabled
number_slider_6 = Slider(100, range=0..1000)  # disabled
number_slider_7 = Slider(100, range=0..1000)  # disabled
number_slider_8 = Slider(0, range=0..1000)  # disabled
toggle = BooleanToggle(True)  # disabled
toggle_2 = BooleanToggle(True)  # disabled
custom_mesh_settings = SettingsCustom(
    StitchSeams=toggle_2,
    SimplePlanes=False,
    Refine=toggle,
    MinCount=number_slider_5,
    MaxCount=number_slider_6,
    AspectRatio=number_slider_8,
    MaxDistance=number_slider_4,
    MaxAngle=number_slider_7,
    MinEdge=0,
    MaxEdge=0)  # disabled
mesh = MeshBrep(
    Brep=merge,
    Settings={GridMaxCount=0, GridMinCount=16, JaggedSeams=False, MaxEdgeLength=0, MinEdgeLength=0.0001, MinTolerance=0, Refine=True, RefineAngle=0, RelativeTolerance=0.65, SimplePlanes=True, Tolerance=0})
mjoin = MeshJoin(Meshes=mesh)
mshclsd = IsMeshClosed(Mesh=mjoin)
gate = StreamGate(Stream="255", Gate=mshclsd)  # -> Target0, Target1
mesh_closed = Panel(mshclsd)
rgb = ColourRGB(Alpha=Slider(43, range=0..100), Red=0, Green=gate.Target1, Blue=0)
mcol = MeshColours(Mesh=mjoin, Colours=rgb)
mesh_2 = Mesh(mcol)
