# Grasshopper definition storage-BOX.gh (Grasshopper 1.0.8)
# plug-ins: Pufferfish, Fologram for Grasshopper

augdoc = AugmentedDocument(
    augmented_trigger_0_key=height_of_the_front_face,
    augmented_trigger_1_key=depth_of_the_box,
    augmented_trigger_2_key=offset_from_the_floor_wheel_ht,
    augmented_trigger_3_key=box_s_back_wall_offset_from_knee_wall,
    num_augmented_triggers=4)

offset_from_the_floor_wheel_ht = Slider(200, range=0..200)
height_of_the_front_face = Slider(1120, range=0..2000)  # disabled
depth_of_the_box = Slider(800, range=0..2000)
box_s_back_wall_offset_from_knee_wall = Slider(54, range=0..100)
front_face_height_ratio = Slider(0.65, range=0..0.9)

vec = VectorXYZ(XComponent="100", YComponent=0, ZComponent="81.5")  # -> Vector, Length
X = UnitX(Factor=1)
unit = UnitVector(Vector=vec.Vector)
angle = Angle(VectorA=X, VectorB=unit)  # -> Angle, Reflex

pt = ConstructPoint(XCoordinate=0, YCoordinate=0, ZCoordinate=offset_from_the_floor_wheel_ht)
pt_2 = Point(pt)
height_knee_wall = Panel("780")
expression = Expression(x=angle.Angle, y=box_s_back_wall_offset_from_knee_wall, Expression="tan(x)*y")
expression_2 = Expression(x=height_knee_wall, y=expression, z=offset_from_the_floor_wheel_ht, Expression="x + y - z")
X_2 = UnitX(Factor=depth_of_the_box)
Z = UnitZ(Factor=expression_2)
move = Move(Geometry=pt_2, Motion=X_2)  # -> Geometry, Transform
move_2 = Move(Geometry=pt_2, Motion=Z)  # -> Geometry, Transform

expression_3 = Expression(x=angle.Angle, y=depth_of_the_box, Expression="y/ cos(x)")
amp = Amplitude(Vector=unit, Amplitude=expression_3)

deg = Degrees(Radians=angle.Angle)
panel = Panel(deg)

move_3 = Move(Geometry=move_2.Geometry, Motion=amp)  # -> Geometry, Transform
subtraction = Subtraction(A=height_of_the_front_face, B=expression_2)  # disabled
ln = Line(StartPoint=move_2.Geometry, EndPoint=move_3.Geometry)
expression_4 = Expression(x=angle.Angle, y=subtraction, Expression="y/ sin(x)")  # disabled
len = Length(Curve=ln)  # disabled
dom = ConstructDomain(DomainStart=0, DomainEnd=1)  # disabled
dom_2 = ConstructDomain(DomainStart=0, DomainEnd=len)  # disabled
remap = RemapNumbers(Value=expression_4, Source=dom_2, Target=dom)  # -> Mapped, Clipped; disabled
eval = EvaluateCurve(Curve=reparameterize(ln), Parameter=front_face_height_ratio)  # -> Point, Tangent, Angle

shelfs_equal_dist = Slider(2, range=2..10)
individual_shelfs = GenePool(Decimals=2, Maximum=1, Minimum=0, Value=[0.15, 0.29, 0.72])
shelf_style = Slider(1, range=0..1)

pdecon = Deconstruct(Point=eval.Point)  # -> XComponent, YComponent, ZComponent
pdecon_2 = Deconstruct(Point=move.Geometry)  # -> XComponent, YComponent, ZComponent
pt_3 = ConstructPoint(XCoordinate=pdecon_2.XComponent, YCoordinate=pdecon_2.YComponent, ZCoordinate=pdecon.ZComponent)

panel_2 = Panel("""-1
0""")

ln_2 = Line(StartPoint=move_2.Geometry, EndPoint=eval.Point)
ln_3 = Line(StartPoint=pt_3, EndPoint=move.Geometry)
ln_4 = Line(StartPoint=pt_2, EndPoint=move.Geometry)
ln_5 = Line(StartPoint=pt_2, EndPoint=move_2.Geometry)
ln_6 = Line(StartPoint=eval.Point, EndPoint=pt_3)
merge = Merge(Data1=ln_6, Data2=ln_2, Data3=ln_3, Data4=ln_4, Data5=ln_5)

# ----
# Platform Depth
len_2 = Length(Curve=ln_6)
panel_3 = Panel(len_2)

Y = UnitY(Factor=Slider(1572, range=0..10000))
extr = Extrude(Base=merge, Direction=Y)
join = BrepJoin(Breps=extr)  # -> Breps, Closed
cap = CapHoles(Brep=join.Breps)

# ---- group: REPLACING FRONT WITH DOORS
debrep = DeconstructBrep(Brep=cap)  # -> Faces, Edges, Vertices
item = ListItem(List=debrep.Faces, Index=Slider(2, range=0..3), Wrap=True)
debrep_2 = DeconstructBrep(Brep=item)  # -> Faces, Edges, Vertices
item_2 = ListItem(List=debrep_2.Edges, Index=[Slider(2, range=0..3), Slider(0, range=0..3)], Wrap=True)
midpt = CurveMiddle(Curve=item_2)
item_3 = ListItem(List=midpt, Index=0, Wrap=True)  # -> Item, Item1
dom_3 = ConstructDomain(DomainStart=Slider(-1, range=-1..1), DomainEnd=1)
ln_7 = Line(StartPoint=item_3.Item, EndPoint=item_3.Item1)
X_3 = UnitX(Factor=dom_3)
extr_2 = Extrude(Base=ln_7, Direction=X_3)
split = SplitBrep(Brep=debrep_2.Faces, Cutter=extr_2)  # -> simplify(Result)
debrep_3 = DeconstructBrep(Brep=split)  # -> Faces, Edges, Vertices
boundary = BoundarySurfaces(Edges=debrep_3.Edges)  # -> flatten(Surfaces)
ins = InsertItems(List=debrep.Faces, Item=boundary, Indices=Slider(2, range=0..20), Wrap=False)
cull_i = CullIndex(List=ins, Indices=Slider(4, range=0..20), Wrap=False)

# ----
item_4 = ListItem(List=extr, Index=0, Wrap=True)  # -> Item, Item1, Item2, Item3
division = Division(A=offset_from_the_floor_wheel_ht, B=2)
srf = Surface(item_4.Item3)
debrep_4 = DeconstructBrep(Brep=srf)  # -> Faces, Edges, Vertices
Z_2 = UnitZ(Factor=division)
neg = Negative(Value=Z_2)
move_4 = Move(Geometry=debrep_4.Edges, Motion=neg)  # -> Geometry, Transform
neg_2 = Negative(Value=Slider(150, range=0..200))
join_2 = JoinCurves(Curves=move_4.Geometry, Preserve=False)
offset = OffsetCurve(Curve=join_2, Distance=neg_2, Corners=1)
debrep_5 = DeconstructBrep(Brep=offset)  # -> Faces, Edges, Vertices
pt_4 = Point(debrep_5.Vertices)
xz = XZPlane(Origin=pt_4)
cyl = Cylinder(Base=xz, Radius=division, Length=Slider(100, range=0..100))
cap_2 = CapHoles(Brep=cyl)

# ---- group: EXTRUDE TO WOOD BOARDS
pt_5 = Point(Point(0.5, 0.5, 0))
evalsrf = EvaluateSurface(Surface=reparameterize(cull_i), Point=pt_5)  # -> Point, Normal, UDirection, VDirection, Frame
number_slider = Slider(20, range=0..1000)
amp_2 = Amplitude(Vector=evalsrf.Normal, Amplitude=number_slider)
rev = Reverse(Vector=amp_2)
extr_3 = Extrude(Base=cull_i, Direction=amp_2)
move_5 = Move(Geometry=extr_3, Motion=rev)  # -> Geometry, Transform

# ----
debrep_6 = DeconstructBrep(Brep=cull_i)  # -> flatten(Faces), flatten(Edges), Vertices
panel_4 = Panel("""5
8
9""")
item_5 = ListItem(List=panel_4, Index=0, Wrap=True)  # -> Item, Item1, Item2
item_6 = ListItem(List=debrep_6.Faces, Index=item_5.Item2, Wrap=True)
item_7 = ListItem(List=debrep_6.Faces, Index=item_5.Item1, Wrap=True)
item_8 = ListItem(List=debrep_6.Faces, Index=item_5.Item, Wrap=True)
pt_6 = Point(Point(0.5, 0.5, 0))
evalsrf_2 = EvaluateSurface(Surface=reparameterize(item_8), Point=pt_6)  # -> Point, Normal, UDirection, VDirection, Frame
evalsrf_3 = EvaluateSurface(Surface=reparameterize(item_7), Point=pt_6)  # -> Point, Normal, UDirection, VDirection, Frame
evalsrf_4 = EvaluateSurface(Surface=reparameterize(item_6), Point=pt_6)  # -> Point, Normal, UDirection, VDirection, Frame
addition = Addition(A=evalsrf_3.Normal, B=evalsrf_4.Normal)
addition_2 = Addition(A=evalsrf_2.Normal, B=evalsrf_4.Normal)

expression_5 = Expression(x=number_slider, Expression="x * sqrt(2)")
filedge = FilletEdge(
    Shape=move_5.Geometry,
    Blend=1,
    Metric=2,
    Edges=[Slider(0, range=0..16), Slider(1, range=0..16), Slider(2, range=0..16), Slider(3, range=0..16)],
    Radii=expression_5)

item_9 = ListItem(List=debrep_6.Edges, Index=Slider(5, range=0..31), Wrap=True)  # -> graft(Item)
item_10 = ListItem(List=debrep_6.Edges, Index=Slider(0, range=0..1), Wrap=True)  # -> graft(Item)
neg_3 = Negative(Value=Slider(61, range=0..1000))
amp_3 = Amplitude(Vector=addition, Amplitude=neg_3)
amp_4 = Amplitude(Vector=addition_2, Amplitude=neg_3)
move_6 = Move(Geometry=item_10, Motion=amp_3)  # -> Geometry, Transform
move_7 = Move(Geometry=item_9, Motion=amp_4)  # -> Geometry, Transform
loft = Loft(
    Curves=[item_10, move_6.Geometry],
    Options={Adjust=False, Closed=False, LoftEnds=0, LoftSimp=0, LoftType=0, Rebuild=10, Refit=0.01})
loft_2 = Loft(
    Curves=[item_9, move_7.Geometry],
    Options={Adjust=False, Closed=False, LoftEnds=0, LoftSimp=0, LoftType=0, Rebuild=10, Refit=0.01})

number_slider_2 = Slider(1, range=0..16)
item_11 = ListItem(List=move_5.Geometry, Index=number_slider_2, Wrap=True)
expression_6 = Expression(x=number_slider, Expression="x * sqrt(2)")
filedge_2 = FilletEdge(Shape=item_11, Blend=1, Metric=2, Edges=[Slider(3, range=0..16), Slider(2, range=0..16)], Radii=expression_6)
preview = CustomPreview(Geometry=filedge_2, Material=ColourSwatch(SwatchColor=RGBA(18, 110, 30, 113)))
split_2 = SplitBrep(Brep=filedge_2, Cutter=loft)
item_12 = ListItem(List=split_2, Index=Slider(3, range=0..3), Wrap=True)
split_3 = SplitBrep(Brep=item_12, Cutter=loft_2)
item_13 = ListItem(List=split_3, Index=Slider(1, range=0..3), Wrap=True)
cap_3 = CapHoles(Brep=item_13)

number_slider_3 = Slider(0, range=0..16)
item_14 = ListItem(List=move_5.Geometry, Index=number_slider_3, Wrap=True)
expression_7 = Expression(x=number_slider, Expression="x * sqrt(2)")
filedge_3 = FilletEdge(
    Shape=item_14,
    Blend=1,
    Metric=2,
    Edges=[Slider(3, range=0..16), Slider(2, range=0..16), Slider(1, range=0..16)],
    Radii=expression_7)
preview_2 = CustomPreview(Geometry=filedge_3, Material=ColourSwatch(SwatchColor=RGBA(18, 110, 30, 113)))
split_4 = SplitBrep(Brep=filedge_3, Cutter=loft)
item_15 = ListItem(List=split_4, Index=Slider(1, range=0..3), Wrap=True)
cap_4 = CapHoles(Brep=item_15)

number_slider_4 = Slider(5, range=0..16)
item_16 = ListItem(List=move_5.Geometry, Index=number_slider_4, Wrap=True)
expression_8 = Expression(x=number_slider, Expression="x * sqrt(2)")
filedge_4 = FilletEdge(
    Shape=item_16,
    Blend=1,
    Metric=2,
    Edges=[Slider(1, range=0..16), Slider(2, range=0..16), Slider(3, range=0..16)],
    Radii=expression_8)
preview_3 = CustomPreview(Geometry=filedge_4, Material=ColourSwatch(SwatchColor=RGBA(18, 110, 30, 113)))
split_5 = SplitBrep(Brep=filedge_4, Cutter=loft_2)
item_17 = ListItem(List=split_5, Index=Slider(1, range=0..3), Wrap=True)
cap_5 = CapHoles(Brep=item_17)

merge_2 = Merge(Data1=cap_3, Data2=cap_4, Data3=cap_5)  # -> flatten(Result)
# https://www.youtube.com/watch?v=f3g5kR64ZIM
replace = ReplaceItems(List=filedge, Item=merge_2, Indices=[number_slider_2, number_slider_3, number_slider_4], Wrap=False)
preview_4 = CustomPreview(Geometry=replace, Material=ColourSwatch(SwatchColor=RGBA(158, 158, 158, 113)))

xy = XYPlane(Origin=Point(0, 0, 0))
xz_2 = XZPlane(Origin=Point(0, 0, 0))
yz = YZPlane(Origin=Point(0, 0, 0))
flippln = FlipPlane(Plane=xy, FlipX=False, FlipY=False, FlipZ=True)  # -> Flipped, R
panel_5 = Panel("Perspective")
merge_3 = Merge(Data1=xz_2, Data2=yz, Data3=flippln.Flipped)
number_slider_5 = Slider(38, range=0..100)
pt_7 = Point(<point referenced from the Rhino model>)
geo = Geometry(<curve referenced from the Rhino model>)
m2d_perspective = Make2DPerspectiveView(Camera=pt_7, Frame=geo)
brec = BoundingRectangle(Geometry=replace, Plane=merge_3, Axis=0, Slide=0, Union=True)  # -> Bounding, DimensionX, DimensionY
rev_2 = Reverse(Vector=merge_3)  # -> graft(Vector)
offset_2 = OffsetCurve(Curve=brec.Bounding, Distance=number_slider_5, Plane=graft(merge_3), Corners=1)
amp_5 = Amplitude(Vector=rev_2, Amplitude=number_slider_5)
move_8 = Move(Geometry=offset_2, Motion=rev_2)  # -> Geometry, Transform
rec = Rectangle(move_8.Geometry)
item_18 = ListItem(List=flatten(rec), Index=0, Wrap=True)  # -> flatten(Item), flatten(Item1), flatten(Item2)
panel_6 = Panel(rec)
m2d_parallel = Make2DParallelView(Projection=item_18.Item)
make2d = Make2D(Geometry=replace, View=m2d_parallel, TangentEdges=False, TangentSeams=False, AutoComputeMake2D=False)  # -> VisibleCurves, VisibleIndex, VisibleType, HiddenCurves, HiddenIndex, HiddenType
crv = Curve(make2d.HiddenCurves)
crv_2 = Curve(make2d.VisibleCurves)
number_slider_6 = Slider(29, range=0..100)
end = EndPoints(Curve=crv_2)  # -> Start, End
lineardim = LinearDimension(Line=crv_2, PointA=end.Start, PointB=end.End, Text="{0:0.00}", Size=Slider(31, range=0..100))

# ----
# total height
# Front face height
# table top depth
pdecon_3 = Deconstruct(Point=pt_3)  # -> XComponent, YComponent, ZComponent
pt_8 = ConstructPoint(XCoordinate=pdecon_3.XComponent, YCoordinate=pdecon_3.YComponent, ZCoordinate=0)

ln_8 = Line(StartPoint=pt_8, EndPoint=pt_3)
crv_3 = Curve(ln_6)
crv_4 = Curve(ln_3)

len_3 = Length(Curve=crv_3)
len_4 = Length(Curve=crv_4)
addition_3 = Addition(A=len_4, B=offset_from_the_floor_wheel_ht)
mm = Panel([addition_3, len_4, len_3])

# ---- group: SHELFS
range = Range(Domain=Domain(0, 1), Steps=shelfs_equal_dist)
flip = FlipCurve(Curve=ln_3)  # -> Curve, Flag
neg_4 = Negative(Value=depth_of_the_box)
X_4 = UnitX(Factor=neg_4)
panel_7 = Panel("""-1
0""")  # disabled

# ----
cull_i_2 = CullIndex(List=range, Indices=panel_2, Wrap=True)

# ---- group: SHELFS (continued)
filter = StreamFilter(Gate=shelf_style, Stream0=cull_i_2, Stream1=individual_shelfs)
eval_2 = EvaluateCurve(Curve=reparameterize(flip.Curve), Parameter=filter)  # -> Point, Tangent, Angle
move_9 = Move(Geometry=eval_2.Point, Motion=X_4)  # -> Geometry, Transform
pdecon_4 = Deconstruct(Point=eval_2.Point)  # -> XComponent, YComponent, ZComponent
ln_9 = Line(StartPoint=eval_2.Point, EndPoint=move_9.Geometry)
pt_9 = ConstructPoint(XCoordinate=pdecon_4.XComponent, YCoordinate=pdecon_4.YComponent, ZCoordinate=pdecon_4.ZComponent)
ccx = CurveCurve(CurveA=graft([ln_5, ln_2]), CurveB=ln_9)  # -> flatten(Points), ParamsA, ParamsB
ln_10 = Line(StartPoint=pt_9, EndPoint=ccx.Points)
cull_i_3 = CullIndex(List=ln_10, Indices=panel_7, Wrap=True)  # disabled
extr_4 = Extrude(Base=ln_10, Direction=Y)
