# Grasshopper definition THOWL_RoboLab_UR10e_Template.gh (Grasshopper 1.0.8)
# plug-ins: Robots, Human

brep = Brep([<brep referenced from the Rhino model> x10])

pick_geometry = Brep(<brep referenced from the Rhino model>)
place_geometry = Brep(brep)

safe_z = Slider(200, range=0..1000)
safe_z_2 = Slider(150, range=0..1000)

# ---- group: Pick up Material
# PICKING
brep_to_plane = BrepToPlane(brep=pick_geometry, angle=Slider(0, range=0..1000))  # -> flatten(geometry)
duplicate = Duplicate(data=brep_to_plane, list=place_geometry)
pln = Plane(graft(duplicate))
Z = UnitZ(Factor=safe_z_2)
move = Move(Geometry=pln, Motion=Z)  # -> Geometry, Transform
xy = XYPlane(Origin=pln)
xy_2 = XYPlane(Origin=move.Geometry)
merge = Merge(Data1=move.Geometry, Data2=pln, Data3=move.Geometry)

# ---- group: robot system
# robot system
# Platform
number_slider = Slider(1278, range=0..3100)
crv = Curve(<curve referenced from the Rhino model>)
list = RobotsLibrary(
    {"AARCH IRB120", "AARCH IRB6620", "CREATE IRB6650S", "CREATE-KR240 R3330 Full", "UR3e", "UR5e", "UR10e", "UR16e", "UR3", "UR5", "UR10", "UR20", "UR30"}, selected="UR10e",
    Type=0)
eval = EvaluateLength(Curve=crv, Length=number_slider, Normalized=False)  # -> Point, Tangent, Parameter
loadrobot = LoadRobotSystem(Name=list, Base=eval.Point)

# ---- group: Commands
# COMMANDS
panel = Panel("""  rq_set_pos_spd_for(opening, 255, 255, "1")
  rq_wait_pos_spe_for_request(opening, 255, 255, "1")
  rq_go_to("1")
  rq_wait("1")""")
panel_2 = Panel("popup (\"Test test test\", warning=False, error=False, blocking=True)")
rep = ReplaceText(Text=panel, Find="opening", Replace=Slider(0, range=0..255), RecursiveReplace=False)
rep_2 = ReplaceText(Text=panel, Find="opening", Replace=Slider(150, range=0..255), RecursiveReplace=False)
rep_3 = ReplaceText(Text=panel, Find="opening", Replace=Slider(255, range=0..255), RecursiveReplace=False)
customcmd = CustomCommand(Name="Open_tool", Manufacturer="All", Code=rep)
customcmd_2 = CustomCommand(Name="HalfOpen_tool", Manufacturer="All", Code=rep_2)
customcmd_3 = CustomCommand(Name="Pendulum_Message", Manufacturer="UR", Code=panel_2)
customcmd_4 = CustomCommand(Name="Closed_tool", Manufacturer="All", Code=rep_3)
entwine = Entwine(Branch00=customcmd, Branch01=customcmd_4, Branch02=customcmd_3, Branch03=customcmd_2, FlattenInputs=True)  # -> flatten(Result)

# ----
Z_2 = UnitZ(Factor=safe_z)

panel_3 = Panel("sardenberg@iat.uni-hannover.de")

command = Panel(entwine)
speeds = Panel("""2000,pi*2
350,pi*2
100,pi""")
moment_type = Panel("""Joint
Linear""")
zones = Panel("""50
2
0""")
movement_tool_speed_zone_command = Panel("""0,2,1,1,0
0,2,2,2,1
0,1,2,2,1
0,1,1,1,1
0,1,2,2,3
0,2,1,2,2""")
list_2 = FlagFields({"Shoulder": 1, "Elbow": 2, "Wrist": 4}, selected=[])
aarhus_header = Text(["step_count_a9838946_43b5_4485_861a_25271bc6f74c = 0", "  thread Step_Counter_Thread_6106626b_aeb8_42cf_bb02_af929db44954():", "    while (True):", "      step_count_a9838946_43b5_4485_861a_25271bc6f74c = step_count_a9838946_43b5_4485_861a_25271bc6f74c + 1", "      sync()", "    end"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])
customcmd_5 = CustomCommand(Name="CustomCommand", Manufacturer="All", Code=aarhus_header)

# ---- group: Place Material
# PLACING
number_slider_2 = Slider(0, range=0..1000)
sorting = Sorting(relay=place_geometry)

# ----
brep_to_plane_2 = BrepToPlane(brep=sorting, angle=number_slider_2)  # -> flatten(geometry)

# ---- group: Place Material (continued)
pln_2 = Plane(graft(brep_to_plane_2))
move_2 = Move(Geometry=pln_2, Motion=Z_2)  # -> Geometry, Transform
weave = Weave(Pattern=[1, 0, 2], Stream0=pln_2, Stream1=move_2.Geometry, Stream2=move_2.Geometry, NullGaps=False)

# ---- group: SORTER
lng = ListLength(List=pln_2)
panel_4 = Panel("""1
1
1
0
0
0""")
dup = DuplicateData(Data=panel_4, Number=lng, Order=True)

# ---- group: 2-Finger-Gripper
# TOOL
number_slider_3 = Slider(90, range=0..100)
crv_2 = Curve(<curve referenced from the Rhino model>)
open_tool_mesh = Mesh(<mesh referenced from the Rhino model>)
closed_tool_mesh = Mesh(<mesh referenced from the Rhino model>)
curvepoint = PointOnCurve(crv_2, parameter=0)
curvepoint_2 = PointOnCurve(crv_2, parameter=0.5)
curvepoint_3 = PointOnCurve(crv_2, parameter=1)
mjoin = MeshJoin(Meshes=closed_tool_mesh)
panel_5 = Panel("""Closed_tool
Closed_tool_with_slat
Open_tool""")
mjoin_2 = MeshJoin(Meshes=open_tool_mesh)
pl_3pt = Plane3Pt(PointA=curvepoint_2, PointB=curvepoint, PointC=curvepoint_3)
pl = PlaneNormal(Origin=pl_3pt, ZAxis="0,0,-1")

# ----
tool_mesh_generator = ToolMeshGenerator(angle=number_slider_3, target=pl_3pt, list=pick_geometry)
mjoin_3 = MeshJoin(Meshes=flatten([closed_tool_mesh, tool_mesh_generator]))

# ---- group: 2-Finger-Gripper (continued)
merge_2 = Merge(Data1=mjoin, Data2=mjoin_3, Data3=mjoin_2)
tool = CreateTool(Name=panel_5, TCP=pl, Weight=0, Mesh=merge_2)  # -> Tool, TCP

# ----
tools = Panel(tool.Tool)

speed = SpeedParameter(speeds)
# TARGET: Picking UP
# Picking DOWN
# Picking UP
# Placing UP
# Placing DOWN
# Placing UP
command_2 = CommandParameter(entwine)
zone = ZoneParameter(zones)
movement = Text(moment_type)
tool_2 = Data(tool.Tool)
weave_2 = Weave(Pattern=dup, Stream0=weave, Stream1=merge, NullGaps=False)
entwine_2 = Entwine(Branch00=movement, Branch01=tool_2, Branch02=speed, Branch03=zone, Branch04=command_2, FlattenInputs=True)
flip = FlipMatrix(Data=weave_2)
split = TextSplit(Text=movement_tool_speed_zone_command, Separators=",")
flip_2 = FlipMatrix(Data=split)
item = ListItem(List=entwine_2, Index=flip_2, Wrap=True)
flip_3 = FlipMatrix(Data=item)
item_2 = ListItem(List=flip_3, Index=0, Wrap=True)  # -> Item, Item1, Item2, Item3, Item4
target = CreateTarget(
    Plane=flip,
    RobConf=list_2,
    Motion=item_2.Item,
    Tool=item_2.Item1,
    Speed=item_2.Item2,
    Zone=item_2.Item3,
    Command=item_2.Item4,
    IsCartesian=True)
flip_4 = FlipMatrix(Data=target)  # -> flatten(Data)

item_3 = ListItem(List=flip_4, Index=Slider(270, range=0..1000), Wrap=True)
detarget = DeconstructTarget(Target=item_3)  # -> Joints, Plane

# ----
# HOME
number_slider_4 = Slider(500, range=0..1000)
item_4 = ListItem(List=tool.Tool, Index=0, Wrap=True)
target_2 = CreateTarget(Joints="0, -0.5 * Pi,0,-0.5 * Pi,0,0", Tool=item_4, Speed=number_slider_4, IsCartesian=False)

merge_3 = Merge(Data1=target_2, Data2=flip_4, Data3=target_2)
program = CreateProgram(Name="DefaultProgram", RobotSystem=loadrobot, Targets=merge_3, InitCommands=customcmd_5, StepSize=1)  # -> Program, Code, Duration, Warnings, Errors
panel_6 = Panel(program.Errors)

sim = ProgramSimulation(Program=program.Program, Time=Slider(0, range=0..1), Normalized=True)  # -> SystemMeshes, JointRotations, Plane, Index, Time, Program, Errors
division = Division(A=sim.Index, B=6)
subtraction = Subtraction(A=division, B=0.4)
split_2 = SplitList(List=sorting, Index=subtraction)  # -> ListA, ListB
brep_2 = Brep(split_2.ListA)

upload = Button()
play = Button()
pause = Button()
remoteur = RemoteUR(Program=program.Program, IP="169.254.118.190", Upload=upload, Play=play, Pause=pause)

swatch = ColourSwatch(SwatchColor=RGB(0, 204, 255))
mesh = Mesh(sim.SystemMeshes)
preview = CustomPreview(Geometry=brep_2, Material=swatch)

previewmat = CustomPreviewMaterials(Geometry=brep_2, DiffuseColor=swatch)

# ==== cluster Sorting
relay = ClusterInput()
area = Area(Geometry=relay)  # -> Area, Centroid
deconstruct = Deconstruct(Point=area.Centroid)  # -> XComponent, YComponent, ZComponent
sort_list = SortList(Keys=deconstruct.ZComponent, ValuesValuesA=relay)  # -> Keys, ValuesValuesA
values_a = ClusterOutput(sort_list.ValuesValuesA)

# ==== cluster ToolMeshGenerator
list = ClusterInput()
list_item = ListItem(List=list, Index=0, Wrap=True)
volume = Volume(Geometry=list_item)  # -> Volume, Centroid
target = ClusterInput()
orient = Orient(Geometry=list_item, Source=volume.Centroid, Target=target)  # -> Geometry, Transform
angle = ClusterInput()
rotate = Rotate(Geometry=orient.Geometry, Angle=degrees(angle), Plane=PlaneXY(0, 0, 0))  # -> Geometry, Transform
geometry = ClusterOutput(rotate.Geometry)

# ==== cluster Duplicate
list = ClusterInput()
list_length = ListLength(List=list)
data = ClusterInput()
duplicate_data = DuplicateData(Data=data, Number=list_length, Order=True)
split_list = SplitList(List=duplicate_data, Index=list_length)  # -> ListA, ListB
rotate = Rotate(Geometry=split_list.ListA, Angle=degrees(Slider(180, range=0..1000)), Plane=split_list.ListA)  # -> Geometry, Transform
geometry = ClusterOutput(rotate.Geometry)

# ==== cluster BrepToPlane
brep = ClusterInput()
deconstruct_brep = DeconstructBrep(Brep=brep)  # -> Faces, Edges, Vertices
area = Area(Geometry=deconstruct_brep.Faces)  # -> Area, Centroid
deconstruct = Deconstruct(Point=area.Centroid)  # -> XComponent, YComponent, ZComponent
sort_list = SortList(Keys=deconstruct.ZComponent, ValuesValuesA=deconstruct_brep.Faces)  # -> Keys, ValuesValuesA
list_item = ListItem(List=reverse(sort_list.ValuesValuesA), Index=0, Wrap=True)
md_slider = MDSlider(SliderMode=0, slider_value=Point(0.5, 0.5, 0.5), x_domain=Domain(0, 1), y_domain=Domain(0, 1), z_domain=Domain(0, 1))
evaluate_surface = EvaluateSurface(Surface=reparameterize(list_item), Point=md_slider)  # -> Point, Normal, UDirection, VDirection, Frame
number_slider = Slider(0.5, range=0..1)
construct_point = ConstructPoint(XCoordinate=number_slider, YCoordinate=number_slider, ZCoordinate=0)
construct_point_2 = ConstructPoint(XCoordinate=Slider(0.5, range=0..1), YCoordinate=0, ZCoordinate=0)
construct_point_3 = ConstructPoint(XCoordinate=0, YCoordinate=Slider(0.5, range=0..1), ZCoordinate=0)
evaluate_surface_2 = EvaluateSurface(Surface=reparameterize(list_item), Point=construct_point)  # -> Point, Normal, UDirection, VDirection, Frame
evaluate_surface_3 = EvaluateSurface(Surface=reparameterize(list_item), Point=construct_point_2)  # -> Point, Normal, UDirection, VDirection, Frame
evaluate_surface_4 = EvaluateSurface(Surface=reparameterize(list_item), Point=construct_point_3)  # -> Point, Normal, UDirection, VDirection, Frame
plane_3pt = Plane3Pt(PointA=evaluate_surface_2.Point, PointB=evaluate_surface_4.Point, PointC=evaluate_surface_3.Point)
deconstruct_plane = DeconstructPlane(Plane=plane_3pt)  # -> Origin, XAxis, YAxis, ZAxis
deconstruct_2 = Deconstruct(Point=deconstruct_plane.ZAxis)  # -> XComponent, YComponent, ZComponent
number_slider_2 = Slider(516, range=0..1000)
larger_than = LargerThan(FirstNumber=deconstruct_2.ZComponent, SecondNumber=0)  # -> LargerThan, OrEqualTo
sift_pattern = SiftPattern(List=plane_3pt, SiftPattern=larger_than.LargerThan)  # -> Output0, Output1
deconstruct_plane_2 = DeconstructPlane(Plane=sift_pattern.Output0)  # -> Origin, XAxis, YAxis, ZAxis
angle = ClusterInput()
negative = Negative(Value=deconstruct_plane_2.YAxis)
construct_plane = ConstructPlane(Origin=deconstruct_plane_2.Origin, XAxis=deconstruct_plane_2.XAxis, YAxis=negative)
combine_data = CombineData(Input0=construct_plane, Input1=sift_pattern.Output1)  # -> Result, Index
rotate = Rotate(Geometry=combine_data.Result, Angle=degrees(angle), Plane=combine_data.Result)  # -> Geometry, Transform
geometry = ClusterOutput(rotate.Geometry)
